# Grasshopper definition Mesh2Srf_MyLogic_Masterfile.gh (Grasshopper 0.9.76)

mesh = Mesh(<mesh referenced from the Rhino model>)
demesh = DeconstructMesh(Mesh=mesh)  # -> Vertices, Faces, Colours, Normals
pdecon = Deconstruct(Point=demesh.Vertices)  # -> XComponent, YComponent, ZComponent
lng = ListLength(List=pdecon.XComponent)
series = Series(Start=Slider(1, range=0..100), Step=1, Count=lng)
series_2 = Series(Start=Slider(0, range=0..100), Step=1, Count=lng)
item = ListItem(List=pdecon.XComponent, Index=series_2, Wrap=True)
item_2 = ListItem(List=pdecon.XComponent, Index=series, Wrap=True)
smaller = SmallerThan(FirstNumber=item, SecondNumber=item_2)  # -> SmallerThan, OrEqualTo
equals = Equality(FirstNumber=smaller.SmallerThan, SecondNumber="False")  # -> Equality, Inequality
cull = CullPattern(List=smaller.SmallerThan, CullPattern=equals.Equality)
index = ItemIndex(List=smaller.SmallerThan, Item=cull)
reldif = RelativeDifferences(Values=index)
lng_2 = ListLength(List=index)
item_3 = ListItem(List=reldif, Index=Slider(0, range=0..10), Wrap=True)
item_4 = ListItem(List=reldif, Index=Slider(1, range=0..10), Wrap=True)
addition = Addition(A=index, B=1)  # -> flatten(Result)
subtraction = Subtraction(A=lng_2, B=1)
subtraction_2 = Subtraction(A=item_4, B=item_3)
cull_i = CullIndex(List=addition, Indices=subtraction, Wrap=True)  # -> flatten(List)
series_3 = Series(Start=cull_i, Step=1, Count=subtraction_2)
item_5 = ListItem(List=demesh.Vertices, Index=series_3, Wrap=True)
nurbs = NurbsCurve(Vertices=item_5, Degree=3, Periodic=False)  # -> Curve, Length, Domain
loft = Loft(
    Curves=flatten(nurbs.Curve),
    Options={Adjust=False, Closed=False, LoftEnds=0, LoftSimp=0, LoftType=0, Rebuild=10, Refit=0.01})
